# Grasshopper definition codigoGH.gh (Grasshopper 1.0.7)
# plug-ins: onScreen

# ----
# ler csv
panel = Panel("C:\Users\galva\Desktop\DG-AI\grid0.csv")
c_script = CSharpScript(csvFile=panel)  # -> out, pointsBlack, pointsRed; inputs csvFile: String
# ---------- c_script: C# ----------
    pointsBlack = DiscriminatePointsCSV(csvFile, "Black");
    pointsRed = DiscriminatePointsCSV(csvFile, "Red");
# ---------- c_script: C# additional code ----------
  Point3d CreatePoints(int x, int y, int z)
  {
    Point3d points = new Point3d(x, y, z);
    return points;
  }

  List<Point3d> DiscriminatePointsCSV(string file, string condition)
  {
    string[] csvLines = System.IO.File.ReadAllLines(file);

    var points = new List<Point3d>();

    for (int i = 0; i < csvLines.Length; i++)
    {
      string[] rowData = csvLines[i].Split(',');

      string csvCondition = rowData[3];

      int x = Convert.ToInt32(rowData[0]);
      int y = Convert.ToInt32(rowData[2]);
      int z = Convert.ToInt32(rowData[1]);

      if (csvCondition.Contains(condition))
      {
        Point3d point = CreatePoints(x, y, z);
        points.Add(point);
      }
    }
    return points;
  }
# ---------- end c_script ----------
pt = Point(c_script.pointsBlack)
pt_2 = Point(c_script.pointsRed)

# ----
# níveis e loft
curvedivision = Slider(60, range=0..100)
degreecurves = Slider(11, range=1..11)
panel_2 = Panel("""0
2
5
7""")
c_script_2 = CSharpScript(pointList=c_script.pointsRed, heightList=panel_2)  # -> out, simplify(points); inputs pointList: list of Point3d, heightList: Int32
# ---------- c_script_2: C# usings ----------
using System.Linq;
# ---------- c_script_2: C# ----------
    List<Point3d> levelPoints = new List<Point3d>();
    //levelPoints = PointsByLevel(pointList, heightList);

    //points = Point3d.CullDuplicates(levelPoints, 0);

    List<int> height = new List<int>();
    height.Add(0);
    height.Add(8);

    levelPoints = BordersByLevel(pointList, heightList);
    points = Point3d.CullDuplicates(levelPoints, 0);
# ---------- c_script_2: C# additional code ----------
  //List<Point3d> PointsByLevel(List<Point3d> points, int heights)
  //{
  //  List<Point3d> result = new List<Point3d>();

  //  for (int i = 0; i < points.Count; i++)
  //  {
  //    if (points[i].Z >= heights)
  //    {
  //      double zAxis = points[i].Z;
  //      zAxis = heights;

  //      result.Add(new Point3d(points[i].X, points[i].Y, zAxis));
  //    }
  //  }
  //  return result;
  //}

  List<Point3d> BordersByLevel(List<Point3d> points, int height)
  {
    //List<Point3d>[] curves = new List<Point3d>[heights.Count];

    //for (int i = 0; i < heights.Count; i++)
    //{

    //}
    //var height = heights[i];

    var levelPoints = points.Where(p => p.Z >= height);
    var curve = levelPoints.Select(p => new Point3d(p.X, p.Y, height)).Distinct().ToList();

    List<Point3d> result = new List<Point3d>();

    var groupsX = curve.GroupBy(p => p.X).ToDictionary(g => g.Key, g => g.ToList());
    var groupsY = curve.GroupBy(p => p.Y).ToDictionary(g => g.Key, g => g.ToList());

    List<Point3d> border = new List<Point3d>();


    foreach (var group in groupsX)
    {
      var list = group.Value;
      var ordered = list.OrderBy(p => p.Y).ToArray();
      for (int j = 0; j < ordered.Length; j++)
      {
        var current = ordered[j];
        Point3d next;
        Point3d previous;
        if (j - 1 >= 0)
        {
          previous = ordered[j - 1];
          if (current.Y - previous.Y == 1)
          {
            if (j + 1 < ordered.Length)
            {
              next = ordered[j + 1];
              if (next.Y - current.Y != 1)
              {
                border.Add(current);
              }
            }
            else border.Add(current);
          }
          else
          {
            border.Add(current);
          }
        }
        else border.Add(current);
      }
    }

    foreach (var group in groupsY)
    {
      var list = group.Value;
      var ordered = list.OrderBy(p => p.X).ToArray();
      for (int j = 0; j < ordered.Length; j++)
      {
        var current = ordered[j];
        Point3d next;
        Point3d previous;
        if (j - 1 >= 0)
        {
          previous = ordered[j - 1];
          if (current.X - previous.X == 1)
          {
            if (j + 1 < ordered.Length)
            {
              next = ordered[j + 1];
              if (next.X - current.X != 1)
              {
                border.Add(current);
              }
            }
            else border.Add(current);
          }
          else
          {
            border.Add(current);
          }
        }
        else border.Add(current);
      }
    }




    return border;
  }
# ---------- end c_script_2 ----------
branch = Slider(3, range=0..3)
branch_2 = Slider(1, range=0..3)
branch_3 = Slider(2, range=0..3)
viewer = ParamViewer(c_script_2.points)
branch_4 = Slider(0, range=0..3)
branch_5 = TreeBranch(Tree=c_script_2.points, Path=branch, MaintainPaths=True)
branch_6 = TreeBranch(Tree=c_script_2.points, Path=branch_2, MaintainPaths=True)
branch_7 = TreeBranch(Tree=c_script_2.points, Path=branch_3, MaintainPaths=True)
branch_8 = TreeBranch(Tree=c_script_2.points, Path=branch_4, MaintainPaths=True)
item = ListItem(List=branch_5, Index=0, Wrap=True)
item_2 = ListItem(List=branch_6, Index=0, Wrap=True)
item_3 = ListItem(List=branch_7, Index=0, Wrap=True)
item_4 = ListItem(List=branch_8, Index=0, Wrap=True)
pdecon = Deconstruct(Point=item)  # -> XComponent, YComponent, ZComponent
pt_3 = Point(branch_5)
pdecon_2 = Deconstruct(Point=item_2)  # -> XComponent, YComponent, ZComponent
pdecon_3 = Deconstruct(Point=item_3)  # -> XComponent, YComponent, ZComponent
pt_4 = Point(branch_6)
pt_5 = Point(branch_7)
pdecon_4 = Deconstruct(Point=item_4)  # -> XComponent, YComponent, ZComponent
pt_6 = Point(branch_8)
Z = UnitZ(Factor=pdecon.ZComponent)
Z_2 = UnitZ(Factor=pdecon_2.ZComponent)
Z_3 = UnitZ(Factor=pdecon_3.ZComponent)
Z_4 = UnitZ(Factor=pdecon_4.ZComponent)
alpha = AlphaShape(Points=pt_3, Radius=Slider(4.6, range=0..50), Plane=Z)
alpha_2 = AlphaShape(Points=pt_4, Radius=Slider(4.6, range=0..50), Plane=Z_2)
alpha_3 = AlphaShape(Points=pt_5, Radius=Slider(4.6, range=0..50), Plane=Z_3)
alpha_4 = AlphaShape(Points=pt_6, Radius=Slider(4.6, range=0..50), Plane=Z_4)
divide = DivideCurve(Curve=alpha, Count=curvedivision, Kinks=False)  # -> Points, Tangents, Parameters
divide_2 = DivideCurve(Curve=alpha_2, Count=curvedivision, Kinks=False)  # -> Points, Tangents, Parameters
divide_3 = DivideCurve(Curve=alpha_3, Count=curvedivision, Kinks=False)  # -> Points, Tangents, Parameters
divide_4 = DivideCurve(Curve=alpha_4, Count=curvedivision, Kinks=False)  # -> Points, Tangents, Parameters
pline = PolyLine(Vertices=divide.Points, Closed=invert(False))
pline_2 = PolyLine(Vertices=divide_2.Points, Closed=invert(False))
pline_3 = PolyLine(Vertices=divide_3.Points, Closed=invert(False))
pline_4 = PolyLine(Vertices=divide_4.Points, Closed=invert(False))
seam = Seam(Curve=pline, Seam=Slider(56, range=0..100))
seam_2 = Seam(Curve=pline_2, Seam=Slider(18.7, range=0..100))
seam_3 = Seam(Curve=pline_3, Seam=Slider(56.2, range=0..100))
seam_4 = Seam(Curve=pline_4, Seam=Slider(42.4, range=0..100))
divide_5 = DivideCurve(Curve=seam, Count=curvedivision, Kinks=False)  # -> Points, Tangents, Parameters
divide_6 = DivideCurve(Curve=seam_2, Count=curvedivision, Kinks=False)  # -> Points, Tangents, Parameters
divide_7 = DivideCurve(Curve=seam_3, Count=curvedivision, Kinks=False)  # -> Points, Tangents, Parameters
divide_8 = DivideCurve(Curve=seam_4, Count=curvedivision, Kinks=False)  # -> reverse(Points), Tangents, Parameters
points = PointList(Points=divide_5.Points, Size=0.3)
nurbs = NurbsCurve(Vertices=divide_5.Points, Degree=degreecurves, Periodic=invert(False))  # -> flatten(Curve), Length, Domain
points_2 = PointList(Points=divide_6.Points, Size=0.3)
nurbs_2 = NurbsCurve(Vertices=divide_6.Points, Degree=degreecurves, Periodic=invert(False))  # -> flatten(Curve), Length, Domain
points_3 = PointList(Points=divide_7.Points, Size=0.3)
nurbs_3 = NurbsCurve(Vertices=divide_7.Points, Degree=degreecurves, Periodic=invert(False))  # -> flatten(Curve), Length, Domain
points_4 = PointList(Points=divide_8.Points, Size=0.3)
nurbs_4 = NurbsCurve(Vertices=divide_8.Points, Degree=degreecurves, Periodic=invert(False))  # -> flatten(Curve), Length, Domain
loft = Loft(
    Curves=[nurbs_4.Curve, nurbs_2.Curve, nurbs_3.Curve, nurbs.Curve],
    Options={Adjust=False, Closed=False, LoftEnds=0, LoftSimp=0, LoftType=0, Rebuild=10, Refit=0.01})

# ----
# discreta
geo = Geometry(<brep referenced from the Rhino model>)  # disabled
pt_7 = Point([<point referenced from the Rhino model> x4])  # disabled
crv = Curve([<curve referenced from the Rhino model> x4])  # disabled
cap = CapHoles(Brep=loft)  # disabled
number_slider = Slider(21.8, range=0..100)  # disabled
number_slider_2 = Slider(18.4, range=0..100)  # disabled
number_slider_3 = Slider(1.4, range=0..100)  # disabled
conndir = Wasp_ConnectionFromDirection(GEO=geo, CEN=pt_7, UP=crv)  # -> CONN, PLN_OUT; inputs CEN: list of Point3d, UP: list of Curve, T: list; disabled; plug-in component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
points_5 = PointList(Points=pt_7, Size=0.1)  # disabled
panel_3 = Panel("part")  # disabled
mesh = MeshBrep(
    Brep=cap,
    Settings={GridMaxCount=0, GridMinCount=16, JaggedSeams=False, MaxEdgeLength=0, MinEdgeLength=0.0001, MinTolerance=0, Refine=True, RefineAngle=0, RelativeTolerance=0.65, SimplePlanes=True, Tolerance=0})  # disabled
toggle = BooleanToggle(False)  # disabled
toggle_2 = BooleanToggle(True)  # disabled
part = Wasp_BasicPart(NAME=panel_3, GEO=geo, CONN=flatten(conndir.CONN))  # -> PART; inputs GEO: Mesh, CONN: list, ATTR: list; disabled; plug-in component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
vec = VectorXYZ(XComponent=number_slider, YComponent=number_slider_2, ZComponent=number_slider_3)  # -> Vector, Length; disabled
faceb = FaceBoundaries(Mesh=mesh)  # disabled
meshconst = Wasp_MeshConstraint(GEO=mesh, IN=toggle_2, SOFT=toggle)  # -> GC; inputs GEO: Mesh, IN: Boolean, SOFT: Boolean, REQ: Boolean, PART: list; disabled; plug-in component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
move = Move(Motion=vec.Vector)  # -> Geometry, Transform; disabled
partgeo = Wasp_GetPartGeometry(PART=part)  # -> GEO; disabled; plug-in component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
parttr = Wasp_TransformPart(PART=part, TR=move.Transform)  # -> PART_OUT; inputs TR: Transform; disabled; plug-in component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
rulegen = Wasp_RulesGenerator(PART=part)  # -> R; inputs PART: list, SELF_P: Boolean, SELF_C: Boolean, TYP: Boolean, GR: list; disabled; plug-in component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
partgeo_2 = Wasp_GetPartGeometry(PART=parttr)  # -> GEO; disabled; plug-in component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
number_slider_4 = Slider(10, range=0..2000)  # disabled
number_slider_5 = Slider(2, range=0..3)  # disabled
button = Button()  # disabled
stochasticaggregation = Wasp_StochasticAggregation(PART=flatten(part), PREV=parttr, RULES=rulegen, MODE=number_slider_5, GC=meshconst, RESET=button)  # -> AGGR, PART_OUT; inputs PART: list, PREV: list, N: Int32, RULES: list, SEED: Int32, MODE: Int32, GC: list, RESET: Boolean; disabled; plug-in component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
panel_4 = Panel("C:\Users\galva\Desktop\DG-AI")  # disabled
panel_5 = Panel("ag")  # disabled
path = FilePath("C:\Users\galva\Desktop\DG-AI\ag.json")  # disabled
button_2 = Button()  # disabled
loadaggr = Wasp_LoadAggregationFromFile(PART=part, FILE=path)  # -> PART_OUT; inputs PART: list; disabled; plug-in component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
partgeo_3 = Wasp_GetPartGeometry(PART=stochasticaggregation.PART_OUT)  # -> GEO; disabled; plug-in component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
saveaggr = Wasp_SaveAggregationToFile(AGGR=stochasticaggregation.AGGR, PATH=panel_4, NAME=panel_5, SAVE=button_2)  # -> TXT, FILE; inputs SAVE: Boolean; disabled; plug-in component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
partgeo_4 = Wasp_GetPartGeometry(PART=loadaggr)  # -> GEO; disabled; plug-in component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

# ----
# contínua
number_slider_6 = Slider(19, range=1..100)  # disabled
number_slider_7 = Slider(29, range=1..100)  # disabled
number_slider_8 = Slider(20, range=0..50)  # disabled
srf = Surface(loft)  # disabled
number_slider_9 = Slider(1, range=0..1)  # disabled
dom = ConstructDomain(DomainStart=number_slider_6, DomainEnd=number_slider_7)  # disabled
divide_9 = DivideDomain²(Domain=srf, UCount=number_slider_8, VCount=number_slider_9)  # disabled
number_slider_10 = Slider(1, range=0..50)  # disabled
subsrf = Isotrim(Surface=srf, Domain=divide_9)  # disabled
random = Random(Range=dom, Number=number_slider_8, Seed=2)  # disabled
divide_10 = DivideDomain²(Domain=subsrf, UCount=number_slider_10, VCount=random)  # disabled
subsrf_2 = Isotrim(Surface=graft(subsrf), Domain=divide_10)  # -> flatten(Surface); disabled
number_slider_11 = Slider(100, range=0..1000)  # disabled
number_slider_12 = Slider(10, range=0..100)  # disabled
number_slider_13 = Slider(0.99, range=0..1)  # disabled
reduce = RandomReduce(List=subsrf_2, Reduction=number_slider_11, Seed=number_slider_12)  # disabled
number_slider_14 = Slider(0.03, range=0..0.1)  # disabled
area = Area(Geometry=reduce)  # -> Area, Centroid; disabled
scale = Scale(Geometry=reduce, Center=area.Centroid, Factor=number_slider_13)  # -> Geometry, Transform; disabled
offset = OffsetSurface(Surface=scale.Geometry, Distance=number_slider_14, Retrim=True)  # disabled
debrep = DeconstructBrep(Brep=offset)  # -> Faces, Edges, Vertices; disabled
debrep_2 = DeconstructBrep(Brep=scale.Geometry)  # -> Faces, Edges, Vertices; disabled
merge = Merge(Data1=debrep_2.Faces, Data2=debrep.Faces)  # disabled
debrep_3 = DeconstructBrep(Brep=subsrf)  # -> Faces, Edges, Vertices; disabled
number_slider_15 = Slider(0.05, range=0..0.1)  # disabled
loft_2 = Loft(Curves=merge, Options={Adjust=False, Closed=False, LoftEnds=0, LoftSimp=0, LoftType=0, Rebuild=10, Refit=0.01})  # disabled
crv_2 = Curve(debrep_3.Edges)  # disabled
merge_2 = Merge(Data1=merge, Data2=loft_2)  # disabled
pipe = Pipe(Curve=crv_2, Radius=number_slider_15, Caps=0)  # disabled

# ----
# linhas
number_slider_16 = Slider(8, range=0..10)  # disabled
cps = ClosestPoints(Point=pt_2, Cloud=pt_2, Count=number_slider_16)  # -> ClosestPoint, CPIndex, Distance; disabled
pline_5 = PolyLine(Vertices=cps.ClosestPoint, Closed=False)  # disabled
explode = Explode(Curve=pline_5, Recursive=True)  # -> flatten(Segments), Vertices; disabled
number_slider_17 = Slider(0.05, range=0..0.1)  # disabled
crv_3 = Curve(explode.Segments)  # disabled
pipe_2 = Pipe(Curve=crv_3, Radius=number_slider_17, Caps=0)  # disabled

# ----
# voxels
number_slider_18 = Slider(1, range=0..1)  # disabled
box = DomainBox(Base=pt_2, X=number_slider_18, Y=number_slider_18, Z=number_slider_18)  # disabled
