# Grasshopper definition csvMinMax.gh (Grasshopper 1.0.7)

panel = Panel("D:\OneDrive\estudos e trabalhos\trabalhos\2022 - digital futures portuguese\repository\DG-AI_DF\DGAI_Rhino\csvR01.csv")
number_slider = Slider(50, range=0..50)  # disabled
crv = Curve([<curve referenced from the Rhino model> x3])  # disabled
number_slider_2 = Slider(10, range=0..50)  # disabled
loft = Loft(Curves=crv, Options={Adjust=False, Closed=False, LoftEnds=0, LoftSimp=0, LoftType=0, Rebuild=10, Refit=0.01})  # disabled
c_script = CSharpScript(csvFile=panel)  # -> out, pointsLevel1, pointsLevel4; inputs csvFile: String
# ---------- c_script: C# usings ----------
using System.Linq;
# ---------- c_script: C# ----------
    string[] csvLines = System.IO.File.ReadAllLines(csvFile);

    var points_level = new List<int>();
    var level_max = new List<Point3d>();
    var level_min = new List<Point3d>();

    //percorrendo linhas do csv
    for (int i = 0; i < csvLines.Length; i++) {
      //definindo colunas no csv
      string[] rowData = csvLines[i].Split(',');

      //variável de condição (empty, black e red)
      string condition = rowData[3];
      int level = Convert.ToInt32(rowData[1]);
      points_level.Add(level);


      int z_max = points_level.Max();
      int z_min = points_level.Min();


      if (condition.Contains("Red") && level == z_min){
        int x = Convert.ToInt32(rowData[0]);
        int y = Convert.ToInt32(rowData[2]);
        int z = Convert.ToInt32(rowData[1]);

        Point3d points_min = new Point3d(x, y, z);
        level_min.Add(points_min);
      }

      else if (condition.Contains("Red") && level == z_max){
        int x = Convert.ToInt32(rowData[0]);
        int y = Convert.ToInt32(rowData[2]);
        int z = Convert.ToInt32(rowData[1]);

        Point3d points_max = new Point3d(x, y, z);
        level_max.Add(points_max);
      }
    }
    pointsLevel1 = level_min;
    pointsLevel4 = level_max;
# ---------- end c_script ----------
c_script_2 = CSharpScript(csvFile=panel)  # -> out, pointsBlack, pointsRed; inputs csvFile: String
# ---------- c_script_2: C# ----------
    string[] csvLines = System.IO.File.ReadAllLines(csvFile);

    var points_Black = new List<Point3d>();
    var points_Red = new List<Point3d>();



    for (int i = 0; i < csvLines.Length; i++) {
      string[] rowData = csvLines[i].Split(',');

      string condition = rowData[3];

      if (condition.Contains("Black")){
        int x = Convert.ToInt32(rowData[0]);
        int y = Convert.ToInt32(rowData[2]);
        int z = Convert.ToInt32(rowData[1]);
        
        Point3d pointB = new Point3d(x, y, z);
        points_Black.Add(pointB);
      }

      else if (condition.Contains("Red")){
        int x = Convert.ToInt32(rowData[0]);
        int y = Convert.ToInt32(rowData[2]);
        int z = Convert.ToInt32(rowData[1]);

        Point3d pointR = new Point3d(x, y, z);
        points_Red.Add(pointR);
      }
    }
    pointsBlack = points_Black;
    pointsRed = points_Red;
# ---------- end c_script_2 ----------
divide = DivideDomain²(Domain=loft, UCount=number_slider_2, VCount=number_slider)  # disabled
pt = Point(c_script_2.pointsBlack)
pt_2 = Point(c_script_2.pointsRed)
panel_2 = Panel(c_script.pointsLevel1)
panel_3 = Panel(c_script.pointsLevel4)
pt_3 = Point(c_script.pointsLevel1)
pt_4 = Point(c_script.pointsLevel4)
subsrf = Isotrim(Surface=loft, Domain=divide)  # disabled
number_slider_3 = Slider(1, range=0..1)
box = DomainBox(Base=pt_2, X=number_slider_3, Y=number_slider_3, Z=number_slider_3)
wires = BrepWireframe(Brep=box, Density=-1)
